# Grasshopper definition Clock.gh (Grasshopper 1.0.7)

time = ConstructTime(Hour=22, Minute=40, Second=0)
panel = Panel(time)
c_script = CSharpScript(time=time)  # -> out, A
# ---------- c_script: C# ----------
    var H = 0;
    var M = 0;
    var S = 0;

    if (time == null)
    {
      H = DateTime.Now.Hour;
      M = DateTime.Now.Minute;
      S = DateTime.Now.Second;
    }
    else
    {
      H = time.Hour;
      M = time.Minute;
      S = time.Second;
    }

    A = S;
# ---------- end c_script ----------
panel_2 = Panel(c_script.out)
panel_3 = Panel(c_script.A)
