# Grasshopper definition time.gh (Grasshopper 1.0.7)

time = ConstructTime(Hour=Slider(0, range=0..24), Minute=Slider(0, range=0..60), Second=Slider(60, range=0..60))
timer = Timer(TimerInterval=1000, Target=c_script)
c_script = CSharpScript(time=time)  # -> out, H, M, S, Clocks
# ---------- c_script: C# ----------
    if (time == null);
    time = DateTime.Now;



    double hAngle = ((time.Hour % 12 * 30 + time.Minute * 0.5) * (-Math.PI / 180));
    double mAngle = (time.Minute * 6) * (-Math.PI / 180);
    double sAngle = (time.Second * 6) * (-Math.PI / 180);

    var centerPt = new Point3d(0, 0, 0);
    var hourBaseLine = new Line(centerPt, new Point3d(0, 300, 0));
    var minuteBaseLine = new Line(centerPt, new Point3d(0, 400, 0));
    var secondBaseLine = new Line(centerPt, new Point3d(0, 450, 0));

    hourBaseLine.Transform(Transform.Rotation(hAngle, centerPt));
    minuteBaseLine.Transform(Transform.Rotation(mAngle, centerPt));
    secondBaseLine.Transform(Transform.Rotation(sAngle, centerPt));

    H = hourBaseLine;
    M = minuteBaseLine;
    S = secondBaseLine;

    Clocks = new Rhino.Geometry.Circle(centerPt, 600);
# ---------- end c_script ----------
data = Data(c_script.H)
data_2 = Data(c_script.M)
data_3 = Data(c_script.S)
data_4 = Data(c_script.Clocks)
