# Grasshopper definition test 01.gh (Grasshopper 1.0.7)
# plug-ins: Robot, TestPlugin

F = File(["E:\Repos\ROBOT_BI\FlatsOBD\ver2\1.5S_type1_46.48_m_L_D.json", "E:\Repos\ROBOT_BI\FlatsOBD\ver2\1.5S_type2_48.4_m_R_U.json", "E:\Repos\ROBOT_BI\FlatsOBD\ver2\1.5S_type3_50.04_m_R_U.json", "E:\Repos\ROBOT_BI\FlatsOBD\ver2\1.5S_type4_49.95_b_L_D.json", "E:\Repos\ROBOT_BI\FlatsOBD\ver2\1.5S_type5_49.65_b_L_D.json", "E:\Repos\ROBOT_BI\FlatsOBD\ver2\1.5XS_type1_43.61_m_L_D.json", "E:\Repos\ROBOT_BI\FlatsOBD\ver2\1M_type1_40.87_m_R_U.json", "E:\Repos\ROBOT_BI\FlatsOBD\ver2\1M_type2_39.23_m_R_U.json", "E:\Repos\ROBOT_BI\FlatsOBD\ver2\1M_type3_37.59_m_R_U.json", "E:\Repos\ROBOT_BI\FlatsOBD\ver2\1M_type4_40.86_m_L_U.json", "E:\Repos\ROBOT_BI\FlatsOBD\ver2\1S_type1_34.31_m_L_D.json", "E:\Repos\ROBOT_BI\FlatsOBD\ver2\2M_type1_59.59_m_R_U.json", "E:\Repos\ROBOT_BI\FlatsOBD\ver2\2M_type2_59.76_m_R_U.json", "E:\Repos\ROBOT_BI\FlatsOBD\ver2\2M_type3_57.57_b_L_U.json", "E:\Repos\ROBOT_BI\FlatsOBD\ver2\2S_type1_53.2_m_L_D.json", "E:\Repos\ROBOT_BI\FlatsOBD\ver2\2S_type2_52.51_b_L_U.json", "E:\Repos\ROBOT_BI\FlatsOBD\ver2\2S_type3_52.33_b_L_U.json", "E:\Repos\ROBOT_BI\FlatsOBD\ver2\2S_type4_52.61_b_R_D.json", "E:\Repos\ROBOT_BI\FlatsOBD\ver2\2S_type5_49.91_b_L_D.json", "E:\Repos\ROBOT_BI\FlatsOBD\ver2\3M_type1_80.17_b_R_U.json", "E:\Repos\ROBOT_BI\FlatsOBD\ver2\3M_type1_81.68_b_L_D.json", "E:\Repos\ROBOT_BI\FlatsOBD\ver2\3M_type2_81.88_b_L_D.json", "E:\Repos\ROBOT_BI\FlatsOBD\ver2\3M_type3_81.99_b_L_D.json", "E:\Repos\ROBOT_BI\FlatsOBD\ver2\3M_type5_78.68_b_L_U.json", "E:\Repos\ROBOT_BI\FlatsOBD\ver2\3S_type1_73.11_b_L_U.json", "E:\Repos\ROBOT_BI\FlatsOBD\ver2\3XS(E)_type3_68.31_b_L_D.json", "E:\Repos\ROBOT_BI\FlatsOBD\ver2\3XS(E)_type4_61.89_b_R_U.json", "E:\Repos\ROBOT_BI\FlatsOBD\ver2\3XS_type1_69.27_b_L_D.json", "E:\Repos\ROBOT_BI\FlatsOBD\ver2\4M_type1_104.69_b_L_D.json", "E:\Repos\ROBOT_BI\FlatsOBD\ver2\4S_type1_88.53_b_L_D.json"])
F_2 = File("E:\Repos\ROBOT_BI\Modules\Apt_combinations\combinations_7.txt")
file = ReadFile(File=F, PerLineParse=False)
file_2 = ReadFile(File=F_2, PerLineParse=False)
readflat = ReadFlat(JSON=file)  # -> flatten(Flat)
item = ListItem(Index=0, Wrap=True)
nickname = TestPlugin(Flats=readflat, Combinations=file_2)
number_slider = Slider(1000, range=0..1000)
panel = Panel(nickname)
c_script = CSharpScript(x=readflat, Reference="E:\Repos\c-sharp-tasks\08_TestPlugin\TestPlugin\References\Robot.dll")  # -> out, A
# ---------- c_script: C# usings ----------
using Robot;
# ---------- c_script: C# ----------
    var flat = x as Robot.Flat;
    A = flat.Code;
# ---------- end c_script ----------
deflat = DeconstructFlat(Flat=readflat)  # -> ID, Contour, Windows, Door, Plane, Rooms, GrossArea, Top, Bottom
item_2 = ListItem(List=nickname, Index=0, Wrap=True)
panel_2 = Panel(c_script.A)
X = UnitX(Factor=Slider(37100, range=0..100000))
bbox = BoundingBox(Content=deflat.Contour, Plane=PlaneXY(0, 0, 0))  # -> Box, Box_2
Y = UnitY(Factor=Slider(2321, range=0..10000))
delevel = DeconstructLevel(Level=item_2)  # -> ID, FloorNo, Flats, LLU, Contour, MOP, Walls, AptType
box_corners = BoxCorners(Box=bbox.Box)  # -> graft(CornerA), graft(CornerB), graft(CornerC), graft(CornerD), CornerE, CornerF, CornerG, CornerH
move = Move(Geometry=item_2, Motion=X)  # -> Geometry, Transform
item_3 = ListItem(List=delevel.Flats, Index=Slider(3, range=0..10), Wrap=True)
number_slider_2 = Slider(1500, range=0..10000)
avr = Average(Input=[box_corners.CornerA, box_corners.CornerB])
avr_2 = Average(Input=[box_corners.CornerA, box_corners.CornerB, box_corners.CornerC, box_corners.CornerD])
avr_3 = Average(Input=[box_corners.CornerC, box_corners.CornerD])
move_2 = Move(Geometry=avr_3, Motion=Y)  # -> Geometry, Transform
deflat_2 = DeconstructFlat(Flat=item_3)  # -> ID, Contour, Windows, Door, Plane, Rooms, GrossArea, Top, Bottom
panel_3 = Panel(deflat_2.ID)
panel_4 = Panel(deflat_2.Top)
panel_5 = Panel(deflat_2.Bottom)
tag = TextTag3D(Location=avr, Text=graft(deflat.Bottom), Size=number_slider_2, Justification=7)
tag_2 = TextTag3D(Location=avr_3, Text=graft(deflat.Top), Size=number_slider_2, Justification=7)
tag_3 = TextTag3D(Location=avr_2, Text=graft(panel_2), Size=number_slider_2, Justification=5)
tag_4 = TextTag(Location=avr_3)
tag_5 = TextTag3D(Location=move_2.Geometry, Text=graft(deflat.ID), Size=Slider(500, range=0..1000), Justification=5)
